vi "index.gviweb"   [G Web Development Software 22.3.0]
panel controls:
  "Exit (development only)": bool
  "Data Grid": cluster{"Waveform": i32, "Duration": f64}[]
  "Abort": bool
  "Test Start": bool
  "Cancel": bool
  "Test Sequence": T2[]
panel indicators:
  "Test Record": cluster{"Number": f64, "Pass": bool}[]
  "Total Duration": f64
  "Step Status": cluster{"Progress": f64, "Pass": "Color.gtype"}[]
  "Test History": f64[]
  "manager": error
  "ui": error
  "Program Log": string
  "dev status": string
  "Status": string
  "Initialized": bool
  "Finalized": bool
  "io": error
  "Time Elapsed": f64
  "number elements in queue - seen UI": i32
  "Output": f64[][]
  "number elements in queue - true": i32
  "Graph": f64[][]
  "Pass": bool
types:
  "Color.gtype" = u32
  T1 = cluster{"Waveform": enum{"Constant", "Sawtooth", "Sinusoid"}, "Amplitude": f64, "Frequency": f64}
  T2 = cluster{"Duration (s)": f64, "Waveform Data": T1, "Fault Probability": f64}
  "Manager State.gtype" = enum{"Idle", "Initialize", "Execute", "Finalize"}
  "Message Queue Names.gtype" = enum{"Manager", "UI", "IO"}
  "Step Data.gtype" = cluster{"Message Queue": "Message Queue Names.gtype", "Action": string}
  "Sequence.gtype" = cluster{"Manager State": "Manager State.gtype", "Steps": "Step Data.gtype"[]}
  "Manager Data.gtype" = cluster{"Current State": "Manager State.gtype", "Current Step": "Step Data.gtype", "Remaining Steps": "Step Data.gtype"[], "Remaining Sequences": "Sequence.gtype"[]}
  "Step Result.gtype" = enum{"Pass", "Fail", "Canceled"}
  "Step Status.gtype" = cluster{"Progress": f64, "Result": "Step Result.gtype", "Complete": bool}
  "Waveforms.gtype" = enum{"Constant", "Sawtooth", "Sinusoid"}
  "IO Data.gtype" = cluster{"Waveform": "Waveforms.gtype", "Duration (s)": f64, "Start Time": timestamp, "Time Factor": f64, "Adjusted Amplitude": f64, "New Wave": bool, "Wave Active": bool, "Fault start time": f64}
uses:
  WebApp::support::Message Queue::Create All Message Queues.gvi
  WebApp::support::Message Queue::Dequeue Message.gvi
  WebApp::support::Message Queue::Enqueue Message (Single).gvi
  WebApp::UI messages::Append Log Text.gviweb
  WebApp::program sequences::Handle Next Sequence.gviweb
  WebApp::program sequences::Handle Next Step.gviweb
  NI::G Core::Error::Build Error Cluster.gvi
  WebApp::UI messages::Send Sequence Complete UI Updates.gviweb
  WebApp::UI messages::Update Program Status.gviweb
  WebApp::support::Error Handler - Message Handling Loop.gvi
  WebApp::support::Error Handler - Event Handling Loop.gvi
  WebApp::Report Step Complete.gviweb
  WebApp::Receive IO Data.gviweb
  WebApp::Prep Step Staus for Display.gviweb
  WebApp::globals.gviweb
  WebApp::IO::Handle Next Waveform.gviweb
  WebApp::IO::Generate Waveform.gviweb
  WebApp::IO::Handle Hardware IO.gviweb
  WebApp::debug::Check Test Sequence Complete.gviweb
diagram:
  # #debug
  Property Node(instance in=reference to "dev status", "Value"="") -> (error out=w1)
  w2 = bool FALSE  # Stop Event
  Create User Event[EventName="Stop Event"](error in=w1, user event data type=w2) -> (error out=w3, user event out=w4)
  w5 = [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]  # Instructions
  # Make list of messages for easy screening
  for {
    w6 = each element of w5
    Property Node(instance in=w6) -> ("Init Info:Start Message"=w8)
    append w8 to w7
  }
  # Idle
  #
  # Start Pressed
  #
  # Initializaing
  # 	>> To IO ---Initialize
  # 	Waiting on UI
  # 	>> To UI ---Initialize
  # 	Waiting on IO
  # Executing
  # 	>> To IO ---Execute
  # 	Waiting on IO
  # Finalizing
  # 	>> To IO ---Finalize
  # 	Waiting on IO
  # 	>> To UI ---Finalize
  # 	Waiting on UI
  # Completed
  Build Array("Manager", "UI", "IO") -> w9
  Array Size(array=w9) -> (size(s)=w10)
  call "Create All Message Queues.gvi"(Loop Count=w10, error in=w3) -> (Message Queues=w11, error out=w12)
  Array Index(array=w11) -> (out0[_]=w13, out1[_]=w14, out2[_]=w15)
  s1 = uninitialised  # shift register
  while {
    call "Dequeue Message.gvi"(message queue in=w13, error in=w12) -> (message queue out=w16, message=w17, message data=w18, error out=w19)
    # Manager Loop
    # w4: Stop Event
    case (w17) ignore case {  # Message Cases
      frame "SW Init" {
        w20 = w19
        w21 = default
        w22 = "Manager Data.gtype" {all zero or empty}
      }
      frame "Execute Test" {
        # #CodeNeeded - Perform whatever actions correspond to the "Something Else" message.
        # Send string to "Update Display" message
        call "Enqueue Message (Single).gvi"(message queue in=w16, message="Update Display", message data="\"Do Something Else\" button pressed", error in=w19) -> (error out=w20)
        w21 = default
        w22 = s1
      }
      frame "Error" {
        # #CodeRecommended - Consider creating a system for logging errors in some way. These errors are for notification purposes only. Handling of specific errors should be performed in the message frames that generated the error.
        Variant To Data(error in (no error)=w19, type=no error, variant=w18) -> (data=w23, error out=w20)
        # #CodeRecommended - If you ever change the name of this "Error" message, you'll need to update the name in the Check Loop Error.vi as well.
        $manager <- w23
        w21 = default
        w22 = s1
      }
      frame "---Copy This Frame---" {
        Merge Errors(w19) -> (error out=w20)
        w21 = default
        w22 = s1
      }
      frame "Exit Pressed" {
        s2 = w19  # shift register
        for {
          w24 = each element of w11
          call "Enqueue Message (Single).gvi"(message queue in=w24, message="Exit", error in=s2) -> (error out=w25)
          next s2 = w25
        }
        Merge Errors(s2) -> (error out=w20)
        w21 = default
        w22 = s1
      }
      frame "Exit" {
        Generate User Event(event data=TRUE, user event=w4) -> (error out=w26)
        Release Queue(queue=w16) -> (error out=w27)
        Merge Errors(w27, w26) -> (error out=w20)
        w21 = TRUE
        w22 = s1
      }
      frame Default {
        Search 1D Array(1D array=w7, element=w17) -> (index of element=w28)
        case (w28) {
          frame Default {
            Property Node(instance in=s1) -> ("Current State"=w29, instance out=w30)
            Array Index(array=w5) -> (out0[w28]=w31)
            Property Node(instance in=w31) -> ("Init Info:Valid Starts"=w32, instance out=w33)
            Search 1D Array(1D array=w32, element=w29) -> (index of element=w34)
            # Message in sequence start list -> ensure in valid start state
            case (w34) {
              frame Default {
                call "Append Log Text.gviweb"(Input=w11, resulting string="******************\nStart\n******************", error out=w19) -> (Output_2=w35)
                Property Node(instance in=w33) -> ("Sequences"=w36)
                # In valid state for recieved message -> react
                call "Handle Next Sequence.gviweb"(manager data in=w30, Sequences=w36, error in=w35, Message Queues=w11) -> (manager data out=w37, Sequence Steps=w38, Sequences Empty=w39, error out=w40)
                case (w39) {
                  frame True {
                    w41 = "-------------------------------------\nSequences Empty\n-------------------------------------"
                    # #verify
                    call "Append Log Text.gviweb"(Input=w11, resulting string=w41, error out=w40) -> (Output_2=w20)
                    w22 = w37
                  }
                  frame False {
                    call "Handle Next Step.gviweb"(message queues=w11, manager data in=w37, Sequence Steps=w38, Input=w40) -> (manager data out=w22, Output=w20)
                  }
                }
              }
              frame -1 {
                w42 = """-------------------------------------
Received inavalid message for current status

Invalid Message: %s

State: %s
Currently waiting on: %s
-------------------------------------"""
                Property Node(instance in=w30) -> ("Current State"=w43, "Current Step:Message Queue"=w44)
                Format Into String(formatString=w42, errIn=w19, w43, w44, w17) -> (outString=w45, errOut=w46)
                call "Append Log Text.gviweb"(Input=w11, resulting string=w45, error out=w46) -> (Output_2=w20)
                w22 = w30
              }
            }
          }
          frame -1 {
            # Message missing from sequence start list
            w47 = "The invalid message string \"%s\" was received in the Message Handling Loop."
            # Message undefined
            Format Into String(formatString=w47, w17) -> w48
            call "Build Error Cluster.gvi"(code=1, description=w48, error in=w19) -> (error out=w20)
            w22 = s1
          }
        }
        w21 = default
      }
      frame "Step Complete" {
        Property Node(instance in=s1) -> ("Current Step"=w49)
        Variant To Data(error in (no error)=w19, type=w49, variant=w18) -> (data=w50, error out=w51)
        Is Equal[ComparisonMode=CompareAggregates](x=w49, y=w50) -> w52
        case (w52) {
          frame False, Default {
            w20 = w51
            w22 = s1
          }
          frame True {
            Property Node(instance in=s1) -> ("Remaining Steps"=w53, instance out=w54)
            Array Size(array=w53) -> (size(s)=w55)
            Property Node(instance in=w49) -> ("Message Queue"=w56, "Action"=w57)
            Format Into String(formatString="Completed %s %s", errIn=w51, w56, w57) -> (outString=w58, errOut=w59)
            call "Append Log Text.gviweb"(Input=w11, resulting string=w58, error out=w59) -> (Output_2=w60)
            case (w55) {
              frame Default {
                call "Handle Next Step.gviweb"(message queues=w11, manager data in=w54, Sequence Steps=w53, Input=w60) -> (manager data out=w22, Output=w20)
              }
              frame 0 {
                Property Node(instance in=w54) -> ("Remaining Sequences"=w61, "Current State"=w62, instance out=w63)
                call "Send Sequence Complete UI Updates.gviweb"(Current State=w62, Input=w11, Error In=w60) -> (Error out=w64)
                call "Handle Next Sequence.gviweb"(manager data in=w63, Sequences=w61, error in=w64, Message Queues=w11) -> (manager data out=w65, Sequence Steps=w66, Sequences Empty=w67, error out=w68)
                case (w67) {
                  frame False, Default {
                    Property Node(instance in=w65) -> ("Current State"=w69, instance out=w70)
                    Format Into String(formatString="%s", errIn=w68, w69) -> (outString=w71, errOut=w72)
                    call "Update Program Status.gviweb"(resulting string=w71, Message Queues=w11, Input=w72) -> (error out=w73)
                    call "Handle Next Step.gviweb"(message queues=w11, manager data in=w70, Sequence Steps=w66, Input=w73) -> (manager data out=w22, Output=w20)
                  }
                  frame True {
                    # Program sequence complete
                    call "Update Program Status.gviweb"(resulting string="Complete", Message Queues=w11, Input=w68) -> (error out=w74)
                    call "Append Log Text.gviweb"(Input=w11, resulting string="******************\nComplete\n******************", error out=w74) -> (Output_2=w20)
                    w22 = w65
                  }
                }
              }
            }
          }
        }
        w21 = default
      }
    }
    call "Error Handler - Message Handling Loop.gvi"(message queue in=w16, error in=w20) -> (dup error in=w75)
    next s1 = w22
    stop if w21
  }
  # #todo
  # pass/ fail evaluation
  # 	big LED button
  # test duration calculation
  # 	save init/ finalize time constants in global variable
  # check for empty test sequence
  # check for 0 frequency
  # initialize controls
  # error handling - display in status log
  # create/ configure simulation cases/ flags
  # clean up
  # 	save all text log messages in same place
  #
  #
  # #additional functionality
  # ---------------------------------
  # add finalize commands
  # 	log data
  # 		with test meta data/ description
  # 	log results
  # cancel
  # abort
  # hardware fault button
  # 	just poll in UI loop?
  # -------------------------------------------------------
  # cancel
  # abort
  # Display test history/ data
  # Pause
  # select between historical data
  # historical analysis/ comparison
  # Splining/ smooth transitions between waveforms
  # unit tests
  Register For Events("Stop Event"=w4) -> (event registration refnum out=w76)
  # This is the Queued Message Handler design pattern. The Event Handling Loop generates messages based on user interface actions. The Message Handling Loop processes messages generated by the Event Handling Loop, or by other messages.  The messages are string values, so new messages can be added easily to the Message Cases case structure in the Message Handling Loop.  Each message cluster can also provide an optional value for Message Data, which is a variant that can be converted to whatever message-specific data is required.
  s3 = w76  # shift register
  while {
    event (dynamic events = s3) {
      on "Test Start" Value changed {
        # #CodeNeeded - Send the appropriate message for this user interface event.
        call "Enqueue Message (Single).gvi"(message queue in=w13, message="Start") -> (message queue out=w79, error out=w78)
        w77 = default
      }
      on "Exit (development only)" Value changed {
        call "Enqueue Message (Single).gvi"(priority message=TRUE, message queue in=w13, message="Exit Pressed") -> (message queue out=w79, error out=w78)
        w77 = default
      }
      on dynamic event 0 {
        # The Message Handling Loop processed an "Exit" message, which fired this event to stop the Event Handling Loop.
        w77 = TRUE
        w78 = default
        w79 = w13
      }
    }
    call "Error Handler - Event Handling Loop.gvi"(message queue in=w79, error in=w78) -> (dup error in=w80)
    stop if w77
  }
  Unregister For Events(error in=w80, event registration refnum=s3) -> (error out=w81)
  Merge Errors(w81, w75) -> (error out=w82)
  Destroy User Event(error in=w82, user event=w4)
  Obtain Queue(element data type=f64[] [], name="output data") -> (queue out=w83)
  s4 = uninitialised  # shift register
  s5 = uninitialised  # shift register
  s6 = uninitialised  # shift register
  s7 = uninitialised  # shift register
  while {
    call "Dequeue Message.gvi"(message queue in=w14, timeout in milliseconds=s5, error in=w12) -> (timed out?=w84, message queue out=w85, message=w86, message data=w87, error out=w88)
    # UI Update Loop
    case (w86) ignore case {  # Message Cases
      frame "SW Init" {
        Property Node(instance in=reference to "ui", "Value"=no error, error in=w88) -> (error out=w95, instance out=w96)
        Property Node(instance in=reference to "Initialized", "Value"=FALSE, error in=w88) -> (error out=w97, instance out=w98)
        Property Node(instance in=reference to "Status", "Value"="Idle", error in=w88) -> (error out=w99, instance out=w100)
        Property Node(instance in=reference to "Program Log", "Value"="", error in=w88) -> (error out=w101, instance out=w102)
        Build Array(w96, w98, w100, w102) -> w103
        Merge Errors(w95, w97, w99, w101) -> (error out=w104)
        s8 = w104  # shift register
        for {
          w105 = each element of w103
          Close Reference(error in=s8, reference=w105) -> (error out=w106)
          next s8 = w106
        }
        w89 = s8
        w90 = default
        w91 = ""
        w92 = -1
        w93 = f64[][] []
        w94 = "Step Status.gtype"[] []
      }
      frame "Initialize" {
        # Start with one element
        # #improvement - make equal to number of tests steps
        call "Report Step Complete.gviweb"(Manager Queue=w13, This Queue Name="UI", Step Name=w86, Input_3=w88) -> (Output_2=w89)
        w90 = default
        w91 = s4
        w92 = s5
        w93 = s6
        w94 = s7
      }
      frame "Update Status" {
        Variant To Data(error in (no error)=w88, type=string "", variant=w87) -> (data=w107, error out=w89)
        Format Into String(formatString="%s\n%s", s4, w107) -> w91
        $"Program Log" <- w91
        w90 = default
        w92 = s5
        w93 = s6
        w94 = s7
      }
      frame "Update Program Status" {
        Variant To Data(error in (no error)=w88, type=w86, variant=w87) -> (data=w108, error out=w89)
        $Status <- w108
        w90 = default
        w91 = s4
        w92 = s5
        w93 = s6
        w94 = s7
      }
      frame "Initialize Complete" {
        $Initialized <- TRUE
        w89 = w88
        w90 = default
        w91 = s4
        w92 = s5
        w93 = s6
        w94 = s7
      }
      frame "Execute" {
        # start polling to process data from IO loop
        call "Report Step Complete.gviweb"(Manager Queue=w13, This Queue Name="UI", Step Name=w86, Input_3=w88) -> (Output_2=w89)
        w90 = default
        w91 = s4
        w92 = 0
        w93 = f64[][] []
        w94 = [{"Progress"=0, "Result"="Pass", "Complete"=FALSE}]
      }
      frame "Execute Complete" {
        call "Receive IO Data.gviweb"(Test data in=s6, Steps status in=s7, error in=w88, IO Data Queue=w83) -> (Test data out=w93, Steps status out=w94, error out=w109, Test Data for Graph=w110)
        # Handle any data remaining in queue
        call "Prep Step Staus for Display.gviweb"(Steps status out=w94) -> (Step Status=w111)
        Property Node(instance in=reference to "Step Status", "Value"=w111, error in=w109) -> (error out=w112)
        Property Node(instance in=reference to "Graph", "Value"=w110, error in=w112) -> (error out=w89)
        w90 = default
        w91 = s4
        w92 = s5
      }
      frame "Finalize" {
        # stop polling
        call "Report Step Complete.gviweb"(Manager Queue=w13, This Queue Name="UI", Step Name=w86, Input_3=w88) -> (Output_2=w89)
        w90 = default
        w91 = s4
        w92 = -1
        w93 = s6
        w94 = s7
      }
      frame "Finalize Complete" {
        $Finalized <- TRUE
        w89 = w88
        w90 = default
        w91 = s4
        w92 = s5
        w93 = s6
        w94 = s7
      }
      frame "Error" {
        Variant To Data(error in (no error)=w88, type=no error, variant=w87) -> (data=w113, error out=w89)
        # #CodeRecommended - If you ever change the name of this "Error" message, you'll need to update the name in the Check Loop Error.vi as well.
        $ui <- w113
        w90 = default
        w91 = s4
        w92 = s5
        w93 = s6
        w94 = s7
      }
      frame "---Copy This Frame---" {
        Merge Errors(w88) -> (error out=w89)
        w90 = default
        w91 = s4
        w92 = s5
        w93 = s6
        w94 = s7
      }
      frame "Exit" {
        Release Queue(queue=w85) -> (error out=w114)
        Release Queue(queue=w83) -> (error out=w115)
        Merge Errors(w88, w114, w115) -> (error out=w89)
        w90 = TRUE
        w91 = s4
        w92 = s5
        w93 = s6
        w94 = s7
      }
      frame Default {
        case (w84) {
          frame True {
            Wait(time to wait=500)
            call "Receive IO Data.gviweb"(Test data in=s6, Steps status in=s7, error in=w88, IO Data Queue=w83) -> (number elements in queue - seen UI=w116, Test data out=w93, Steps status out=w94, error out=w89, Test Data for Graph=w117)
            Transpose 2D Array(2D array=w117) -> (transposed array=w118)
            $Output <- w118
            $Graph <- w117
            call "Prep Step Staus for Display.gviweb"(Steps status out=w94) -> (Step Status=w119)
            $"Step Status" <- w119
            $"number elements in queue - seen UI" <- w116
          }
          frame False {
            w120 = "The invalid message string \"%s\" was received in the Message Handling Loop."
            Format Into String(formatString=w120, w86) -> w121
            call "Build Error Cluster.gvi"(code=1, description=w121, error in=w88) -> (error out=w89)
            w93 = s6
            w94 = s7
          }
        }
        w90 = default
        w91 = s4
        w92 = s5
      }
    }
    call "Error Handler - Message Handling Loop.gvi"(message queue in=w85, error in=w89) -> (dup error in=w122)
    next s4 = w91
    next s5 = w92
    next s6 = w93
    next s7 = w94
    stop if w90
  }
  s9 = uninitialised  # shift register
  s10 = uninitialised  # shift register
  while {
    Get Queue Status(queue=w83) -> (# elements in queue=w123)
    $"number elements in queue - true" <- w123
    call "Dequeue Message.gvi"(message queue in=w15, timeout in milliseconds=0, error in=w12) -> (timed out?=w124, message queue out=w125, message=w126, message data=w127, error out=w128)
    # UI Update Loop
    case (w126) ignore case {  # Message Cases
      frame "SW Init" {
        Property Node(instance in=reference to "io", "Value"=no error, error in=w128) -> (error out=w129)
        w130 = default
        w131 = s9
        w132 = "IO Data.gtype" {all zero or empty}
      }
      frame "Initialize" {
        disable {
          frame Disabled {
            # #Integrate_Hardware
            # Hardware initialization goes here
          }
          frame Enabled {
            call "globals.gviweb"() -> (Globals=w133)
            # #debug
            Property Node(instance in=w133) -> ("Hardware Init Simulation Time (ms)"=w134)
            Wait(time to wait=w134)
          }
        }
        call "Report Step Complete.gviweb"(Manager Queue=w13, This Queue Name="IO", Step Name=w126, Input_3=w128) -> (Output_2=w129)
        w130 = default
        w131 = s9
        w132 = s10
      }
      frame "Finalize" {
        disable {
          frame Disabled {
            # #Integrate_Hardware
            # Hardware uninitialization goes here
          }
          frame Enabled {
            call "globals.gviweb"() -> (Globals=w135)
            # #debug
            Property Node(instance in=w135) -> ("Hardware Init Simulation Time (ms)"=w136)
            Wait(time to wait=w136)
          }
        }
        call "Report Step Complete.gviweb"(Manager Queue=w13, This Queue Name="IO", Step Name=w126, Input_3=w128) -> (Output_2=w129)
        w130 = default
        w131 = s9
        w132 = s10
      }
      frame "Execute" {
        # #todo move some of this functionality to initialization and check if test sequence is empty
        # report empty back to manager
        call "Handle Next Waveform.gviweb"(Test Sequence in=$"Test Sequence", IO Data In=s10) -> (Test Sequence out=w131, IO Data out=w132)
        w129 = w128
        w130 = default
      }
      frame "Error" {
        Variant To Data(error in (no error)=w128, type=no error, variant=w127) -> (data=w137, error out=w129)
        # #CodeRecommended - If you ever change the name of this "Error" message, you'll need to update the name in the Check Loop Error.vi as well.
        $io <- w137
        w130 = default
        w131 = s9
        w132 = s10
      }
      frame "---Copy This Frame---" {
        Merge Errors(w128) -> (error out=w129)
        w130 = default
        w131 = s9
        w132 = s10
      }
      frame "Exit" {
        Release Queue(queue=w125) -> (error out=w138)
        Merge Errors(w128, w138) -> (error out=w129)
        w130 = TRUE
        w131 = s9
        w132 = s10
      }
      frame Default {
        case (w124) {
          frame True {
            Property Node(instance in=s10) -> ("Wave Active"=w139, instance out=w140)
            # No message -> handle output
            case (w139) {
              frame False, Default {
                w132 = w140
                w129 = w128
                w131 = s9
              }
              frame True {
                Property Node(instance in=w140) -> ("New Wave"=w141, instance out=w142)
                case (w141) {
                  frame False, Default {
                    w143 = w142
                  }
                  frame True {
                    Get Current Time() -> (current time=w144)
                    # only save init timestamp at wave start
                    Property Node(instance in=w142, "Start Time"=w144, "New Wave"=FALSE) -> (instance out=w143)
                  }
                }
                call "Generate Waveform.gviweb"(IO Data=w143) -> (Time Elapsed=w145, IO data out=w146, Wave Value=w147, Fraction Complete=w148)
                call "Handle Hardware IO.gviweb"(IO data in=w146, Hardware output=w147, Time Elapsed=w145) -> (IO data out=w149, Hardware input=w150)
                call "Check Test Sequence Complete.gviweb"(This Queue Name="IO", Test Sequence in=s9, IO data in=w149, Fraction Complete=w148, Manager Queue=w13) -> (Test Sequence out=w131, IO data out=w132, Fraction Complete (includes messages)=w151)
                Build Array(w151, w147, w150) -> w152
                Enqueue Element(element=w152, error in=w128, queue=w83) -> (error out=w129)
                $"Time Elapsed" <- w145
              }
            }
          }
          frame False {
            # Received message
            w153 = "The invalid message string \"%s\" was received in the Message Handling Loop."
            Format Into String(formatString=w153, w126) -> w154
            call "Build Error Cluster.gvi"(code=1, description=w154, error in=w128) -> (error out=w129)
            w132 = s10
            w131 = s9
          }
        }
        w130 = default
      }
    }
    call "Error Handler - Message Handling Loop.gvi"(message queue in=w125, error in=w129) -> (dup error in=w155)
    Wait(time to wait=50)
    next s9 = w131
    next s10 = w132
    stop if w130
  }
